# Grasshopper definition slo_example.gh (Grasshopper 0.9.76)
# plug-ins: Buckminster

number_slider = Slider(6, range=0..100)
number_slider_2 = Slider(13, range=0..100)
pt = ConstructPoint(XCoordinate=number_slider_2, YCoordinate=expr("x/2", number_slider), ZCoordinate=0)
pt_2 = ConstructPoint(XCoordinate=0, YCoordinate=number_slider, ZCoordinate=0)
pt_3 = Point(Point(0, 0, 0))
sqgrid = Square(Plane=PlaneXY(0, 0, 0), Size=1, ExtentX=number_slider_2, ExtentY=number_slider)  # -> Cells, Points
vec = Vector(Vector(0, 0, 0))
vec_2 = Vector(Vector(1, 1, 1))
vec_3 = Vector(Vector(0, -1, 0))
mesh = Mesh(flatten(sqgrid.Cells))
mjoin = MeshJoin(Meshes=mesh)
weld = WeldMesh(Mesh=mjoin, Angle=3.141592654)
grid = BuckminstersGridProximity(Mesh=weld, Distance=Slider(1.5, range=0..10))  # -> SpaceTruss, Nodes
cp = ClosestPoint(Point=pt, Cloud=grid.Nodes)  # -> ClosestPoint, CPIndex, Distance
cp_2 = ClosestPoint(Point=[pt_3, pt_2], Cloud=grid.Nodes)  # -> ClosestPoint, CPIndex, Distance
vdis = VectorDisplay(Anchor=cp.ClosestPoint, Vector=vec_3)
lng = ListLength(List=grid.Nodes)
repeat = RepeatData(Data=vec, Length=lng)
replace = ReplaceItems(List=repeat, Item=vec_2, Indices=cp_2.CPIndex, Wrap=False)
replace_2 = ReplaceItems(List=repeat, Item=vec_3, Indices=cp.CPIndex, Wrap=False)
sharpslo = BuckminstersTopologyOptimisation(Molecular=grid.SpaceTruss, Fixities=replace, Forces=replace_2, Tensile=1, Compressive=1, JointCost=0, Reset=Toggle(True))  # -> Output, Volume, Molecular
timer = Timer(TimerInterval=1000, Target=sharpslo)  # disabled
decompmol = BuckminstersDecomposeMolecularComponent(Molecular=sharpslo.Molecular, Filter=True)  # -> Lines, Colours, Thicknesses, Displacements
